# Grasshopper definition assignment-01.gh (Grasshopper 1.0.8)

# Assignment-01: Bauhaus
number_slider = Slider(0, range=-1..1)
py3 = Python3Script(
    force=number_slider,
    pivot_shift=Slider(0.1, range=-0.7..0.3),
    ball_r=Slider(0.9, range=0.5..1.5),
    disc_r=Slider(1.4, range=0.8..2.2),
    ball_mass=Slider(3, range=1..6),
    disc_mass=Slider(2, range=1..6),
    half_follow=Slider(0.67, range=0..1),
    wedge_h=Slider(6, range=4..8),
    color_shift=Slider(0, range=0..2))  # -> out, geo, col
# ---------- py3: Python ----------
import importlib
import traceback

try:
    import cdf.balance_sculpture as bs
    importlib.reload(bs)
    geo, col = bs.build_balance(
        force=force,
        pivot_shift=pivot_shift,
        ball_r=ball_r,
        disc_r=disc_r,
        ball_mass=ball_mass,
        disc_mass=disc_mass,
        half_follow=half_follow,
        wedge_h=wedge_h,
        color_shift=color_shift,
    )
    out = "OK: %d pieces" % len(geo)
except Exception:
    out = traceback.format_exc()
# ---------- end py3 ----------
material = CreateMaterial(Diffuse=py3.col, Specular=RGB(255, 255, 255), Emission=RGB(0, 0, 0), Transparency=0, Shine=0)
panel = Panel(py3.out)
preview = CustomPreview(Geometry=py3.geo, Material=material)
